# Dynamo custom node GetScheduleDataRows.dyf (Dynamo 1.2.0.2690)
# category: BimorphNodes.Revit.Schedule.Query
# Get the specified row data from a given schedule as strings
# Schedules have a blank row after the headings. Row indexes start at 0

# group: NODE DETAILS
# note: AUTHOR
# Copyright 2016 Thomas Mahon
# @Thomas__Mahon
# note: CONTACT
# www.bimorph.co.uk
# info@bimorph.co.uk
# @bimorphBIM
# note: PACKAGE NAME
# bimorphNodes
# note: GITHUB
# https://github.com/ThomasMahon/bimorphNodes/

scheduleName = Input(scheduleName:string)  # Enter the name of the schedule
rowIndexes = Input(rowIndexes:int[]..[])  # Enter the index or indexes of the required rows. Indexes start from 0
python_script = Python(IN[0]=scheduleName, IN[1]=rowIndexes)
# ---------- python_script.python (53 lines) ----------
#Copyright 2016. All rights reserved. Bimorph Consultancy LTD, 5 St Johns Lane, London EC1M 4BH www.bimorph.co.uk
#Written by Thomas Mahon @Thomas__Mahon info@bimorph.co.uk Package: bimorphNodes
#GitHub: https://github.com/ThomasMahon/bimorphNodes/

import clr

# Import DocumentManager and TransactionManager
clr.AddReference("RevitServices")
import RevitServices
from RevitServices.Persistence import DocumentManager

# Import RevitAPI
clr.AddReference("RevitAPI")
import Autodesk
from Autodesk.Revit.DB import *

doc = DocumentManager.Instance.CurrentDBDocument

sheetListName = IN[0]
rowIndexes = IN[1]

if isinstance(rowIndexes, list):
	indexList = rowIndexes
else:
	indexList = [rowIndexes]

collector = FilteredElementCollector(doc)
collector.OfClass( ViewSchedule );
elementlist = collector.ToElements()

schedule = None
for i in elementlist:
	scheduleViewName = BuiltInParameter.VIEW_NAME
	viewName = i.get_Parameter(scheduleViewName).AsString()
	
	if viewName == sheetListName:
		schedule = i
		break

table = schedule.GetTableData()
section = table.GetSectionData(SectionType.Body)
nRows = section.NumberOfRows
nColumns = section.NumberOfColumns

rowList = []
for row in indexList: 
	if row < nRows: 
		rowData = []
		for c in range(nColumns): 
			rowData.Add( TableView.GetCellText(schedule, SectionType.Body, row, c) )
		rowList.Add( rowData )

OUT = rowList
# ----------------------------------------
scheduleRowData = Output(python_script)
